# Grasshopper definition Bunny.gh (Grasshopper 1.0.7)
# plug-ins: OpenNest, LunchBox, Ivy

# ---- group: 1. Input geometry
# This sample code is created by Joonhaeng Lee
mesh = Mesh(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)
scale = Scale(Geometry=mesh, Center=Point(0, 0, 0), Factor="1.3")  # -> Geometry, Transform
tri = Triangulate(Mesh=scale.Geometry)  # -> Mesh, Count

# ---- group: input material size
size_of_material = Panel("""12
11""")
item = ListItem(List=size_of_material, Index=0, Wrap=True)  # -> Item, Item1
multiplication = Multiplication(A=item.Item, B="25.4")
multiplication_2 = Multiplication(A=item.Item1, B="25.4")
rectangle = Rectangle(Plane=PlaneXY(0, 0, 0), XSize=multiplication, YSize=multiplication_2, Radius=0)  # -> Rectangle, Length

# ----
X = UnitX(Factor=Slider(1000, range=0..1000))
move = Move(Geometry=rectangle.Rectangle, Motion=X)  # -> Geometry, Transform
pi = Pi(Factor="0.5")
xy = XYPlane(Origin=Point(0, 0, 0))
data = Data([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])
explode = Explode(Curve=data, Recursive=True)  # -> Segments, Vertices
item_2 = ListItem(List=explode.Vertices, Index=0, Wrap=True)  # -> Item, Item1
pdecon = Deconstruct(Point=flatten(explode.Vertices))  # -> XComponent, YComponent, ZComponent
pi_2 = Pi(Factor="0.5")
vec2pt = Vector2Pt(PointA=item_2.Item, PointB=item_2.Item1, Unitize=False)  # -> Vector, Length
xy_2 = XYPlane(Origin=Point(0, 0, 0))
sort = SortList(Keys=pdecon.XComponent)  # -> Keys, ValuesA
sort_2 = SortList(Keys=pdecon.YComponent)  # -> Keys, ValuesA
area = Area(Geometry=rectangle.Rectangle)  # -> Area, Centroid
rotate = Rotate(Geometry=vec2pt.Vector, Angle=pi_2, Plane=xy_2)  # -> Geometry, Transform
pl = ConstructPlane(Origin=item_2.Item, XAxis=vec2pt.Vector, YAxis=rotate.Geometry)  # -> simplify(Plane)
item_3 = ListItem(List=sort_2.Keys, Index="-1", Wrap=True)  # -> Item, Item1
item_4 = ListItem(List=sort.Keys, Index="-1", Wrap=True)  # -> Item, Item1
addition = Addition(A=item_3.Item, B=item_3.Item1)
addition_2 = Addition(A=item_4.Item, B=item_4.Item1)
division = Division(A=addition_2, B="2")
division_2 = Division(A=addition, B="2")
pt = ConstructPoint(XCoordinate=division, YCoordinate=division_2, ZCoordinate=0)
pt_2 = Point(pt)
vec2pt_2 = Vector2Pt(PointA=pt_2, PointB=area.Centroid, Unitize=False)  # -> Vector, Length
addition_3 = Addition(A=vec2pt_2.Vector, B=X)
panel = Panel("""_Cut
_Foldin
_Foldout
_Flat""")
data_2 = Data([ColourSwatch(SwatchColor=RGB(0, 0, 255)), ColourSwatch(SwatchColor=RGB(255, 0, 0)), ColourSwatch(SwatchColor=RGB(0, 255, 255)), ColourSwatch(SwatchColor=RGB(0, 255, 0))])
geo = Geometry(move.Geometry)
explode_2 = Explode(Curve=geo, Recursive=True)  # -> Segments, Vertices
join = JoinCurves(Curves=explode_2.Segments, Preserve=False)
button = Button()
swatch = ColourSwatch(SwatchColor=RGB(0, 0, 0))
bake = ObjectBake(BakeToggle=button, GeometryObjects=join, Layer="Paper", ObjectName="GH_Obj", ObjectColor=swatch, LayerColor=swatch)

# ----
# Unfold Mesh
mesh_2 = Mesh(tri.Mesh)
number_slider = Slider(100, range=0..300)
pt_3 = Point("300,0,0")

# ---- group: 2.Create graph on mesh input
grphmsh = GraphFromMesh(InputMesh=mesh_2)

# ----
fsfaceweight = FaceSizeNodeMeshFaceWeight(MeshGraph=grphmsh)

# ---- group: 3. group mesh faces
mrmstnode = MultiRootMSTNodeWeight(MeshGraph=fsfaceweight, RootFaces="0")

# ----
data_3 = Data(simplify(mrmstnode))
mguroll = MeshGraphUnroll(MeshGraph=data_3, StartFace="0", UnrollPlane=PlaneXY(0, 0, 0))  # -> Mesh, simplify(SplitMeshgraphs), simplify(SplitFlatGraphs), simplify(UnrollEdgeSplits)

# ---- group: creating taps
# This function creates tab for assembly, but not working well.
met = EdgeTypes(MeshGraph=data_3)  # -> GraphEdges, simplify(CutEdges)
sflp = SimpleFlap(
    MeshGraph=data_3,
    Width=Slider(0, range=0..10),
    Bevel=Slider(0, range=0..10),
    Double=Toggle(False),
    MeshEdgeIndex=met.CutEdges)  # -> simplify(Flap); disabled

# ----
mesh_3 = Mesh(mguroll.SplitMeshgraphs)

flatfabm = FlatFabricationMulti(
    SplitMeshgraphs=mguroll.SplitMeshgraphs,
    SplitFlatGraphs=mguroll.SplitFlatGraphs,
    Flaps=sflp,
    PieceLocation=PlaneXY(0, 0, 0),
    TextOffset=0.1)  # -> simplify(CutLines), simplify(FoldInLines), simplify(FoldOutLines), FlatLines, Text, simplify(PlaceHolders), InNodeCurves
crv = Curve(flatfabm.CutLines)
crv_2 = Curve(flatfabm.FoldInLines)
crv_3 = Curve(flatfabm.FoldOutLines)
data_4 = Data(flatfabm.PlaceHolders)
piece_arangement = ArangeFlatParts(
    sf=mguroll.SplitFlatGraphs,
    P=pt_3,
    sx=number_slider,
    sy=number_slider,
    rows=Slider(50, range=0..100),
    graph=mguroll.SplitFlatGraphs,
    cut=crv,
    foldin=crv_2,
    foldout=crv_3,
    place_holders=data_4)  # -> graph_2, mesh_2, cut_2, foldin_2, foldout_2, flat_2, position, position_2

medges = MeshEdges(Mesh=mesh_3)  # -> NakedEdges, InteriorEdges, NonManifoldEdges
lng = ListLength(List=mesh_3)
series = Series(Start=0, Step=1, Count=lng)
gradient = Gradient(
    LowerLimit="0",
    UpperLimit=lng,
    Parameter=series,
    stops=[0: RGB(243, 57, 0), 0.1: RGB(236, 27, 60), 0.2: RGB(210, 0, 118), 0.3: RGB(103, 0, 120), 0.4: RGB(39, 72, 161), 0.5: RGB(1, 192, 229), 0.6: RGB(18, 178, 90), 0.7: RGB(79, 186, 8), 0.8: RGB(220, 237, 32), 0.9: RGB(247, 159, 20), 1: RGB(243, 57, 0)])

# ---- group: 4. unfolded lines / Four Types
crv_foldout = Curve(simplify(piece_arangement.foldout_2))
crv_foldin = Curve(simplify(piece_arangement.foldin_2))
crv_cut = Curve(simplify(piece_arangement.cut_2))
crv_flat = Curve(simplify(piece_arangement.flat_2))

# ---- group: 4. unfolded lines
data_5 = Data(simplify(piece_arangement.graph_2))
mesh_4 = Mesh(simplify(piece_arangement.mesh_2))

# ----
preview = CustomPreview(Geometry=mesh_3, Material=gradient)
group = Group(Objects=crv_cut)
group_2 = Group(Objects=crv_foldin)
group_3 = Group(Objects=crv_foldout)
group_4 = Group(Objects=crv_flat)
crv_4 = Curve(crv_cut)
data_6 = Data([group, group_2, group_3, group_4])
data_7 = Data(data_6)
group_5 = Group(Objects=data_7)  # -> flatten(Group)
join_2 = JoinCurves(Curves=crv_4, Preserve=False)  # -> flatten(Curves)
preview_2 = CustomPreview(Geometry=group_5, Material=gradient)
explode_3 = Explode(Curve=join_2, Recursive=True)  # -> Segments, Vertices
item_5 = ListItem(List=explode_3.Vertices, Index=0, Wrap=True)  # -> Item, Item1
opennest = OpenNest(
    Sheets=rectangle.Rectangle,
    Polylines=join_2,
    Spacing="5",
    PlacementType=1,
    Tolerance=0.01,
    Rotations=4,
    Iterations=Slider(10, range=0..10))  # -> Sheets, Polylines, ID, Transform
vec2pt_3 = Vector2Pt(PointA=item_5.Item, PointB=item_5.Item1, Unitize=False)  # -> Vector, Length
rotate_2 = Rotate(Geometry=vec2pt_3.Vector, Angle=pi, Plane=xy)  # -> Geometry, Transform
pl_2 = ConstructPlane(Origin=item_5.Item, XAxis=vec2pt_3.Vector, YAxis=rotate_2.Geometry)  # -> simplify(Plane)
orient = Orient(Geometry=data_6, Source=pl_2, Target=pl)  # -> Geometry, Transform

# ---- group: Nested geometry
move_2 = Move(Geometry=orient.Geometry, Motion=addition_3)  # -> Geometry, Transform

# ----
group_6 = Group(Objects=move_2.Geometry)
item_6 = ListItem(List=move_2.Geometry, Index=0, Wrap=True)  # -> Item, Item1, Item2, Item3
ungroup = Ungroup(Group=group_6)  # -> simplify(Objects)
flatten = FlattenTree(Tree=group_6, Path="{0}")
ungroup_2 = Ungroup(Group=item_6.Item)
ungroup_3 = Ungroup(Group=item_6.Item1)
ungroup_4 = Ungroup(Group=item_6.Item2)
ungroup_5 = Ungroup(Group=item_6.Item3)
lng_2 = ListLength(List=flatten)
ungroup_6 = Ungroup(Group=ungroup)
series_2 = Series(Start=0, Step=1, Count=lng_2)

# ---- group: Four Types
crv_foldout_2 = Curve(simplify(ungroup_4))
crv_foldin_2 = Curve(simplify(ungroup_3))
crv_cut_2 = Curve(simplify(ungroup_2))
crv_flat_2 = Curve(simplify(ungroup_5))

# ----
graft = GraftTree(Tree=series_2, IncludeEmptyLists=True, IncludeNullItems=True)  # -> simplify(Tree)
null = NullItem(Item=ungroup_6)  # -> NullFlags, InvalidFlags, Description
concat = Concatenate(FragmentA="Group_", FragmentB=graft, FragmentC=panel)  # -> simplify(graft(Result))
preview_3 = CustomPreview(Geometry=flatten(group_6), Material=gradient)
dispatch = Dispatch(List=ungroup_6, DispatchPattern=null.NullFlags)  # -> ListA, ListB
geo_2 = Geometry(dispatch.ListB)
lng_3 = ListLength(List=geo_2)
lng_4 = ListLength(List=flatten(group_6))
equals = Equality(FirstNumber=lng_3, SecondNumber="0")  # -> flatten(Equality), Inequality
tstat = TreeStatistics(Tree=geo_2)  # -> Paths, Length, Count
dup = DuplicateData(Data=data_2, Number=lng_4, Order=True)
partition = PartitionList(List=dup, Size="4")
dispatch_2 = Dispatch(List=tstat.Paths, DispatchPattern=equals.Equality)  # -> ListA, ListB
graft_2 = GraftTree(Tree=partition, IncludeEmptyLists=True, IncludeNullItems=True)  # -> simplify(Tree)
branch = TreeBranch(Tree=geo_2, Path=dispatch_2.ListB, MaintainPaths=True)
branch_2 = TreeBranch(Tree=concat, Path=dispatch_2.ListB, MaintainPaths=True)
branch_3 = TreeBranch(Tree=graft_2, Path=dispatch_2.ListB, MaintainPaths=True)

# ---- group: Bake geometry based on groups
bake_2 = ObjectBake(
    BakeToggle=button,
    GeometryObjects=branch,
    Layer=branch_2,
    ObjectName="GH_Obj",
    ObjectColor=branch_3,
    LayerColor=branch_3)

# ==== cluster ArangeFlatParts: A cluster used to arrange the output of the FlatFab component in Ivy
graph = ClusterInput()  # connect the list of flat graphs from the unroll component
mesh = Mesh(graph)
sf = ClusterInput()
P = ClusterInput()
sx = ClusterInput()
sy = ClusterInput()
rows = ClusterInput()  # the number of rows for the grid
lng = ListLength(List=mesh)
data = Data(sf)
area = Area(Geometry=mesh)  # -> Area, Centroid
division = Division(A=lng, B=rows)
cut = ClusterInput()
foldin = ClusterInput()
foldout = ClusterInput()
flat = ClusterInput()
place_holders = ClusterInput()
place_holders_2 = ClusterInput()
expression = Expression(x=division, Expression="Ceiling(x)")
pshift = ShiftPaths(Data=place_holders, Offset=-1)
pshift_2 = ShiftPaths(Data=cut, Offset=-1)
pshift_3 = ShiftPaths(Data=foldin, Offset=-1)
pshift_4 = ShiftPaths(Data=foldout, Offset=-1)
pshift_5 = ShiftPaths(Data=flat, Offset=-1)
pshift_6 = ShiftPaths(Data=place_holders_2, Offset=-1)
recgrid = Rectangular(Plane=P, SizeX=sx, SizeY=sy, ExtentX=expression, ExtentY=rows)  # -> Cells, flatten(Points)
short = ShortestList(ListA=area.Centroid, ListB=recgrid.Points, TrimMode=2)  # -> ListA, ListB
vec2pt = Vector2Pt(PointA=short.ListA, PointB=short.ListB, Unitize=False)  # -> simplify(graft(Vector)), Length
move = Move(Geometry=pshift_2, Motion=vec2pt.Vector)  # -> Geometry, Transform
move_2 = Move(Geometry=pshift_3, Motion=vec2pt.Vector)  # -> Geometry, Transform
move_3 = Move(Geometry=pshift_4, Motion=vec2pt.Vector)  # -> Geometry, Transform
move_4 = Move(Geometry=pshift, Motion=vec2pt.Vector)  # -> Geometry, Transform
move_5 = Move(Geometry=pshift_6, Motion=vec2pt.Vector)  # -> Geometry, Transform
move_6 = Move(Geometry=pshift_5, Motion=vec2pt.Vector)  # -> Geometry, Transform
move_7 = Move(Geometry=graft(mesh), Motion=vec2pt.Vector)  # -> Geometry, Transform
move_8 = Move(Geometry=graft(data), Motion=vec2pt.Vector)  # -> Geometry, Transform
panel = Panel(mesh)
cut_2 = ClusterOutput(move.Geometry)
foldin_2 = ClusterOutput(move_2.Geometry)
flat_2 = ClusterOutput(move_6.Geometry)
position = ClusterOutput(move_4.Geometry)
foldout_2 = ClusterOutput(move_3.Geometry)
position_2 = ClusterOutput(move_5.Geometry)
data_2 = Data(move_8.Geometry)
mesh_2 = ClusterOutput(move_7.Geometry)
graph_2 = ClusterOutput(data_2)
